# Grasshopper definition stableDif_test00_230614.gh (Grasshopper 1.0.7)
# plug-ins: Printborg

panel = Panel("""{
"deforum_settings": {
    "W": 512,
    "H": 512,
    "show_info_on_ui": true,
    "tiling": false,
    "restore_faces": false,
    "seed_resize_from_w": 0,
    "seed_resize_from_h": 0,
    "seed": 1198998675,
    "sampler": "Euler a",
    "steps": 12,
    "batch_name": "Deforum_20230824211650",
    "seed_behavior": "iter",
    "seed_iter_N": 1,
    "use_init": true,
    "strength": 0.8,
    "strength_0_no_init": true,
    "init_image": "\"C:\\Users\\Tao\\Pictures\\wallpapers\\DSCF1774.jpg\"",
    "use_mask": false,
    "use_alpha_as_mask": false,
    "mask_file": "https://deforum.github.io/a1/M1.jpg",
    "invert_mask": false,
    "mask_contrast_adjust": 1.0,
    "mask_brightness_adjust": 1.0,
    "overlay_mask": true,
    "mask_overlay_blur": 4,
    "fill": 1,
    "full_res_mask": true,
    "full_res_mask_padding": 4,
    "reroll_blank_frames": "ignore",
    "reroll_patience": 10.0,
    "motion_preview_mode": false,
    "prompts": {
        "0": "None  tiny cute bunny, vibrant diffraction, highly detailed, intricate, ultra hd, sharp photo, crepuscular rays, in focus --neg nsfw, nude  ",
        "30": "None  anthropomorphic clean cat, surrounded by fractals, epic angle and pose, symmetrical, 3d, depth of field --neg nsfw, nude  ",
        "60": "None  a beautiful coconut --neg photo, realistic  nsfw, nude  ",
        "90": "None  a beautiful durian, award winning photography --neg nsfw, nude  "
    },
    "positive_prompts": null,
    "negative_prompts": "",
    "animation_mode": "2D",
    "max_frames": 30,
    "border": "replicate",
    "angle": "0: (0)",
    "zoom": "0: (1.0025+0.002*sin(1.25*3.14*t/30))",
    "translation_x": "0: (0)",
    "translation_y": "0: (0)",
    "translation_z": "0: (1.75)",
    "transform_center_x": "0: (0.5)",
    "transform_center_y": "0: (0.5)",
    "rotation_3d_x": "0: (0)",
    "rotation_3d_y": "0: (0)",
    "rotation_3d_z": "0: (0)",
    "enable_perspective_flip": false,
    "perspective_flip_theta": "0: (0)",
    "perspective_flip_phi": "0: (0)",
    "perspective_flip_gamma": "0: (0)",
    "perspective_flip_fv": "0: (53)",
    "noise_schedule": "0: (0.065)",
    "strength_schedule": "0: (0.65)",
    "contrast_schedule": "0: (1.0)",
    "cfg_scale_schedule": "0: (7)",
    "enable_steps_scheduling": false,
    "steps_schedule": "0: (25)",
    "fov_schedule": "0: (70)",
    "aspect_ratio_schedule": "0: (1)",
    "aspect_ratio_use_old_formula": false,
    "near_schedule": "0: (200)",
    "far_schedule": "0: (10000)",
    "seed_schedule": "0:(s), 1:(-1), \"max_f-2\":(-1), \"max_f-1\":(s)",
    "pix2pix_img_cfg_scale_schedule": "0:(1.5)",
    "enable_subseed_scheduling": false,
    "subseed_schedule": "0: (1)",
    "subseed_strength_schedule": "0: (0)",
    "enable_sampler_scheduling": false,
    "sampler_schedule": "0: (\"Euler a\")",
    "use_noise_mask": false,
    "mask_schedule": "0: (\"{video_mask}\")",
    "noise_mask_schedule": "0: (\"{video_mask}\")",
    "enable_checkpoint_scheduling": false,
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""")
path = FilePath("C:\Users\taole\source\repos\AI_Print\AI_Print\user_sketch\output\")
panel_2 = Panel("sk-KbD1s3SPXGcnNDDKkzdhSLKwPkP0GWQUtkbIsECaBj3Umeht")
panel_3 = Panel("100")

# ---- group: controlnet scribble tes
panel_4 = Panel("weird green cows")
toggle = BooleanToggle(True)  # disabled
toggle_2 = BooleanToggle(True)  # disabled
number_slider = Slider(22, range=0..50)  # disabled
models = GetControlnetModels(Send=toggle, APIAddress="http://127.0.0.1:7860")  # -> Models, Debug; disabled
modules = GetControlnetModules(Send=toggle_2, APIAddress="http://127.0.0.1:7860")  # -> Models, Debug; disabled
item = ListItem(List=modules.Models, Index=number_slider, Wrap=True)  # disabled
panel_5 = Panel("delicious apple")  # disabled
panel_6 = Panel(item)  # disabled
panel_7 = Panel(models.Models)  # disabled
path_2 = FilePath("C:\Users\taole\source\repos\Printborg\PrintborgGH\user_sketch\scribbleTest_01.png")  # disabled
panel_8 = Panel("20")  # disabled
panel_9 = Panel("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")  # disabled
panel_10 = Panel("scribble_hed")  # disabled
panel_11 = Panel("control_v11p_sd15_scribble [d4ba51ff]")  # disabled
ao_scripts = CreateAlwaysOnScripts(Model=panel_11, Module=panel_10, InputImage=panel_9)  # disabled
panel_12 = Panel("tests")  # disabled
panel_13 = Panel("128")  # disabled
path_3 = FilePath("D:\Repos\Printborg\PrintborgGH\user_sketch\output\")  # disabled
toggle_3 = BooleanToggle(True)  # disabled
a1111payload = CreateAuto1111Payload(
    Prompt=panel_5,
    NegativePrompt="bad, worse, low quality, strange, ugly",
    SamplerName="Euler",
    Steps=panel_8,
    Width=panel_13,
    Height=panel_13,
    AlwaysOnScripts=ao_scripts)  # disabled
a1111t2i = A1111TextToImageGeneration(Generate=toggle_3, APIAddress="http://127.0.0.1:7860", Payload=a1111payload, FileDirectory=path_3, FileName=panel_12)  # -> Images, Strings, Debug; disabled
img = Image(a1111t2i.Images)  # disabled
txt = Text(a1111t2i.Strings)  # disabled
panel_14 = Panel(a1111t2i.Debug)  # disabled
img_2 = Image(txt)  # disabled
txt_2 = Text(img)  # disabled
image = DisplayImage(Plane=PlaneXY(0, 0, 0), Scale=1)  # disabled
panel_15 = Panel(txt_2)  # disabled
gallery = ImageGallery(CycleDelay=30, Randomize=False, UseLocalImages=True, UseRemoteImages=True)

# ----
cyclomatron_x = SampleAsyncComponent(Generate=Button(), APIKey=panel_2, Prompt=Slider(34, range=0..100), FileDirectory=path, FileName="test1")  # -> Output, Debug, Debug_2; disabled
t2i = TextToImagePrompt(Generate=Button(), APIKey=panel_2, Prompt="weird green cows", FileDirectory=path)  # -> RawPOSTResponse, Link; disabled
panel_16 = Panel(t2i.RawPOSTResponse)
panel_17 = Panel(t2i.Link)
deforum = SendDeforumJob(Generate=Button(), APIAddress="http://127.0.0.1:7860", Payload=panel)  # -> SuccessStatus, BatchID, JobIDs, Debug
panel_18 = Panel(deforum.JobIDs)
panel_19 = Panel(deforum.Debug)
panel_20 = Panel(deforum.SuccessStatus)
panel_21 = Panel(deforum.BatchID)
check_deforum = CheckDeforumProgress(On=Button(), APIAddress="http://127.0.0.1:7860", BatchID=panel_21, QueryInterval="2")  # -> Status, Phase, Progress, UpdatesCount, Debug
panel_22 = Panel(check_deforum.Status)
panel_23 = Panel(check_deforum.Phase)
panel_24 = Panel(check_deforum.Progress)
panel_25 = Panel(check_deforum.UpdatesCount)
get_djobs = GetAllDeforumJobs(APIAddress="http://127.0.0.1:7860", Submit=Button())  # -> Jobs, Debug
djob = DeforumJob(get_djobs.Jobs)
decon_djob = DeconstructDeforumJob(DeforumJob=djob)  # -> ID, Status, Phase, Error, Progress, StartedAt, LastUpdated, ExecutionTime, Updates, Outdir

panel_26 = Panel(decon_djob.ID)
panel_27 = Panel(decon_djob.Status)
panel_28 = Panel(decon_djob.Phase)
panel_29 = Panel(decon_djob.Progress)
panel_30 = Panel(decon_djob.ExecutionTime)
panel_31 = Panel(decon_djob.Updates)
panel_32 = Panel(decon_djob.Outdir)

path_4 = FilePath("D:\Repos\Printborg\PrintborgGH\user_sketch\Deforum_20230822170836\20230822170836_000000000.png")
loadimg = LoadImage(FilePath=path_4, Scale=1)
item_2 = ListItem(List=panel_32, Index=0, Wrap=True)
path_5 = FilePath("D:\Repos\Printborg\PrintborgGH\user_sketch\bmpTest.png")
path_6 = FilePath("D:\Repos\Printborg\PrintborgGH\user_sketch\Deforum_20230822170836\20230822170836_000000097.png")
loaddirimg = LoadImagesFromDir(Directory=item_2, Scale=1)
item_3 = ListItem(List=loaddirimg, Index=0, Wrap=True)
loadimg_2 = LoadImage(FilePath=path_5, Scale=1)
img_3 = Image(item_3)
image_2 = DisplayImage(Image=loadimg_2, Plane=PlaneXY(0, 0, 0), Scale=1)

# ---- group: iso contour value
number_slider_2 = Slider(-0.945, range=-20..20)

# ----
number_slider_3 = Slider(2, range=0..100)  # disabled
frepmesh = FRepFromMesh(Mesh=image_2, IsoValue=Slider(0, range=-20..20))
panel_33 = Panel("512")  # disabled
path_7 = FilePath(["D:\Repos\Printborg\PrintborgGH\user_sketch\Deforum_20230822170836\20230822170836.mp4", "D:\Repos\Printborg\PrintborgGH\user_sketch\Deforum_20230822170836\20230822170836_000000000.png", "D:\Repos\Printborg\PrintborgGH\user_sketch\Deforum_20230822170836\20230822170836_000000001.png", "D:\Repos\Printborg\PrintborgGH\user_sketch\Deforum_20230822170836\20230822170836_000000002.png", "D:\Repos\Printborg\PrintborgGH\user_sketch\Deforum_20230822170836\20230822170836_000000003.png", "D:\Repos\Printborg\PrintborgGH\user_sketch\Deforum_20230822170836\20230822170836_000000004.png"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])  # disabled
data_fieldtop = Data(frepmesh)
division = Division(A=panel_33, B=number_slider_3)  # disabled
item_4 = ListItem(List=path_7, Index=1, Wrap=True)  # disabled

# ---- group: extract frep object as layers
numisocontourvalue = Number(number_slider_2)
data_layerfields = Data(data_fieldtop)
mesh_layermeshes = Mesh(image_2)
isoconmulti = IsoContour(Mesh=graft(mesh_layermeshes), Field=graft(data_layerfields), Tolerance=1, IsoValue=numisocontourvalue)
crv_toolpaths = Curve(isoconmulti)

# ----
img_4 = ImportImage(File=item_4, XSamples=division, YSamples=division)  # disabled

# ---- group: mesh resolution
number_slider_4 = Slider(40, range=0..100)  # disabled
number_slider_5 = Slider(40, range=0..100)  # disabled

# ----
rec_objectboundary = Rectangle({Plane=PlaneXY(2.758546524, 2.608586538, 0), Size=Domain2(u=-13.04393851..13.04393851, v=-12.61862209..12.61862209)})  # disabled

rec = Rectangle(rec_objectboundary)  # disabled
area = Area(Geometry=rec)  # -> Area, Centroid; disabled
pdecon = Deconstruct(Point=area.Centroid)  # -> XComponent, YComponent, ZComponent; disabled
item_5 = ListItem(List=pdecon.ZComponent, Index=0, Wrap=True)  # -> Item, Item1; disabled
subtraction = Subtraction(A=item_5.Item, B=item_5.Item1)  # disabled
abs = Absolute(Value=subtraction)  # disabled
num_totalheight = Number(abs)  # disabled

# ---- group: create base meshes
num = Number(number_slider_5)  # disabled
num_2 = Number(number_slider_4)  # disabled
mplane = MeshPlane(Boundary=rec_objectboundary, WidthCount=num, HeightCount=num_2)  # -> Mesh, Area; disabled
mesh_bottom = Mesh(mplane.Mesh)  # disabled

# ---- group: drawing_inputShapes
crv = Curve(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)  # disabled
crv_2 = Curve(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)  # disabled

# ----
number_slider_6 = Slider(-1.133, range=-20..20)  # disabled
facen = FaceNormals()  # -> Centers, Normals; disabled
image_3 = ImageSampler(
    facen.Centers,
    FilePath="D:\Repos\Printborg\PrintborgGH\user_sketch\scribbleTest_01.png",
    Filter="Colour",
    Interpolate=False,
    Umax=1,
    Umin=0,
    Vmax=1,
    Vmin=0,
    Wrap=1)  # disabled

# ---- group: object heights
number_slider_7 = Slider(30, range=0..50)  # disabled
number_slider_8 = Slider(1, range=0..50)  # disabled

# ---- group: create fields
crv_3 = Curve(crv)  # disabled
num_isovalue = Number(number_slider_6)  # disabled
crv_4 = Curve(crv_2)  # disabled
mesh_bottom_2 = Mesh(mesh_bottom)  # disabled
mfield = MeshField(BaseMesh=mesh_bottom_2, DrawingInput=crv_4, IsoValue=num_isovalue, CurveResolution=1)  # disabled
mfield_2 = MeshField(BaseMesh=mesh_bottom_2, DrawingInput=crv_3, IsoValue=num_isovalue, CurveResolution=1)  # disabled
data_fieldbottom = Data(mfield_2)  # disabled
data_fieldtop_2 = Data(mfield)  # disabled

# ---- group: preview colors - will be interpolated
swatch = ColourSwatch(SwatchColor=RGB(166, 171, 19))  # disabled
swatch_2 = ColourSwatch(SwatchColor=RGB(8, 0, 255))  # disabled
col = Colour([swatch, swatch_2])  # disabled

# ---- group: calculate layer dimensions
num_totalheight_2 = Number(number_slider_7)  # disabled
num_layerheight = Number(number_slider_8)  # disabled
division_2 = Division(A=num_totalheight_2, B=num_layerheight)  # disabled
dom = ConstructDomain(DomainStart=0, DomainEnd=num_totalheight_2)  # disabled
range = Range(Domain=dom, Steps=division_2)  # disabled
num_numlayers = Number(division_2)  # disabled
num_layerheights = Number(range)  # disabled

# ----
number_slider_9 = Slider(12, range=0..20)  # disabled

# ---- group: blend top and bottom fields to get intermediate layers
data_fieldbottom_2 = Data(data_fieldbottom)  # disabled
data_fieldtop_3 = Data(data_fieldtop_2)  # disabled
num_layersparamt = Number(number_slider_9)  # disabled
mesh_bottom_3 = Mesh(mesh_bottom)  # disabled
range_2 = Range(Domain=Domain(0, 1), Steps=num_layersparamt)  # disabled
fblendmult = BlendFieldsMultiThreaded(BaseMesh=mesh_bottom_3, Field0=data_fieldbottom_2, Field1=data_fieldtop_3, BlendParameters=range_2)  # -> Debug, BlendFields; disabled
data_layerfields_2 = Data(fblendmult.BlendFields)  # disabled

# ---- group: topBottomPreview
mesh_top = Mesh(mesh_bottom)  # disabled
col_2 = Colour(col)  # disabled
fdisp = FieldDisplay(Mesh=mesh_top, Field=data_fieldbottom, Colors=col_2)  # disabled
fdisp_2 = FieldDisplay(Mesh=mesh_top, Field=data_fieldtop_2, Colors=col_2)  # disabled

# ---- group: create mesh representations of layers
num_layerheights_2 = Number(num_layerheights)  # disabled
mesh_bottom_4 = Mesh(mesh_bottom)  # disabled
Z = UnitZ(Factor=num_layerheights_2)  # disabled
move = Move(Geometry=mesh_bottom_4, Motion=Z)  # -> Geometry, Transform; disabled
mesh_layermeshes_2 = Mesh(move.Geometry)  # disabled

# ---- group: iso contour value
# these two blocks need
# to be replaced with the AI stuff
# - i.e. generating layers from
# input images and extracting
# toolpaths from the layers
number_slider_10 = Slider(0.443, range=-20..20)  # disabled

# ----
col_3 = Colour(col)  # disabled

# ---- group: layer preview as fields
mesh_layermeshes_3 = Mesh(mesh_layermeshes_2)  # disabled
data_layerfields_3 = Data(data_layerfields_2)  # disabled
col_4 = Colour(col_3)  # disabled
fdisp_3 = FieldDisplay(Mesh=mesh_layermeshes_3, Field=data_layerfields_3, Colors=col_4)  # disabled

# ----
number_slider_11 = Slider(0, range=0..30)  # disabled
number_slider_12 = Slider(0.225, range=-20..20)  # disabled

# ---- group: extract frep object as layers
numisocontourvalue_2 = Number(number_slider_10)  # disabled
data_layerfields_4 = Data(data_layerfields_2)  # disabled
mesh_layermeshes_4 = Mesh(mesh_layermeshes_2)  # disabled
isoconmulti_2 = IsoContour(Mesh=graft(mesh_layermeshes_4), Field=graft(data_layerfields_4), Tolerance=1, IsoValue=numisocontourvalue_2)  # disabled
crv_toolpaths_2 = Curve(isoconmulti_2)  # disabled

# ----
item_6 = ListItem(List=data_layerfields_4, Index=0, Wrap=True)  # disabled
item_7 = ListItem(List=mesh_layermeshes_4, Index=number_slider_11, Wrap=True)  # disabled
item_8 = ListItem(List=data_layerfields_4, Index=number_slider_11, Wrap=True)  # disabled
isoconmulti_3 = IsoContour(Mesh=graft(item_7), Field=graft(item_8), Tolerance=1, IsoValue=number_slider_12)  # disabled
item_9 = ListItem(List=crv_toolpaths_2, Index=0, Wrap=True)  # disabled
