# Grasshopper definition stableDif_test01_240118.gh (Grasshopper 1.0.7)
# plug-ins: Printborg, VoxelTools, Monolith

path = FilePath("C:\Users\taole\source\repos\AI_Print\AI_Print\user_sketch\output\")
panel = Panel("sk-KbD1s3SPXGcnNDDKkzdhSLKwPkP0GWQUtkbIsECaBj3Umeht")
panel_2 = Panel("100")
cyclomatron_x = SampleAsyncComponent(Generate=Button(), APIKey=panel, Prompt=Slider(34, range=0..100), FileDirectory=path, FileName="test1")  # -> Output, Debug, Debug_2; disabled
t2i = TextToImagePrompt(Generate=Button(), APIKey=panel, Prompt="weird green cows", FileDirectory=path)  # -> RawPOSTResponse, Link; disabled
panel_3 = Panel(t2i.RawPOSTResponse)
panel_4 = Panel(t2i.Link)
panel_5 = Panel("""{
"deforum_settings": {
    "W": 512,
    "H": 512,
    "show_info_on_ui": true,
    "tiling": false,
    "restore_faces": false,
    "seed_resize_from_w": 0,
    "seed_resize_from_h": 0,
    "seed": 1198998675,
    "sampler": "Euler a",
    "steps": 12,
    "batch_name": "Deforum_20230824211650",
    "seed_behavior": "iter",
    "seed_iter_N": 1,
    "use_init": true,
    "strength": 0.8,
    "strength_0_no_init": true,
    "init_image": "\"C:\\Users\\Tao\\Pictures\\wallpapers\\DSCF1774.jpg\"",
    "use_mask": false,
    "use_alpha_as_mask": false,
    "mask_file": "https://deforum.github.io/a1/M1.jpg",
    "invert_mask": false,
    "mask_contrast_adjust": 1.0,
    "mask_brightness_adjust": 1.0,
    "overlay_mask": true,
    "mask_overlay_blur": 4,
    "fill": 1,
    "full_res_mask": true,
    "full_res_mask_padding": 4,
    "reroll_blank_frames": "ignore",
    "reroll_patience": 10.0,
    "motion_preview_mode": false,
    "prompts": {
        "0": "None  tiny cute bunny, vibrant diffraction, highly detailed, intricate, ultra hd, sharp photo, crepuscular rays, in focus --neg nsfw, nude  ",
        "30": "None  anthropomorphic clean cat, surrounded by fractals, epic angle and pose, symmetrical, 3d, depth of field --neg nsfw, nude  ",
        "60": "None  a beautiful coconut --neg photo, realistic  nsfw, nude  ",
        "90": "None  a beautiful durian, award winning photography --neg nsfw, nude  "
    },
    "positive_prompts": null,
    "negative_prompts": "",
    "animation_mode": "2D",
    "max_frames": 30,
    "border": "replicate",
    "angle": "0: (0)",
    "zoom": "0: (1.0025+0.002*sin(1.25*3.14*t/30))",
    "translation_x": "0: (0)",
    "translation_y": "0: (0)",
    "translation_z": "0: (1.75)",
    "transform_center_x": "0: (0.5)",
    "transform_center_y": "0: (0.5)",
    "rotation_3d_x": "0: (0)",
    "rotation_3d_y": "0: (0)",
    "rotation_3d_z": "0: (0)",
    "enable_perspective_flip": false,
    "perspective_flip_theta": "0: (0)",
    "perspective_flip_phi": "0: (0)",
    "perspective_flip_gamma": "0: (0)",
    "perspective_flip_fv": "0: (53)",
    "noise_schedule": "0: (0.065)",
    "strength_schedule": "0: (0.65)",
    "contrast_schedule": "0: (1.0)",
    "cfg_scale_schedule": "0: (7)",
    "enable_steps_scheduling": false,
    "steps_schedule": "0: (25)",
    "fov_schedule": "0: (70)",
    "aspect_ratio_schedule": "0: (1)",
    "aspect_ratio_use_old_formula": false,
    "near_schedule": "0: (200)",
    "far_schedule": "0: (10000)",
    "seed_schedule": "0:(s), 1:(-1), \"max_f-2\":(-1), \"max_f-1\":(s)",
    "pix2pix_img_cfg_scale_schedule": "0:(1.5)",
    "enable_subseed_scheduling": false,
    "subseed_schedule": "0: (1)",
    "subseed_strength_schedule": "0: (0)",
    "enable_sampler_scheduling": false,
    "sampler_schedule": "0: (\"Euler a\")",
    "use_noise_mask": false,
    "mask_schedule": "0: (\"{video_mask}\")",
    "noise_mask_schedule": "0: (\"{video_mask}\")",
    "enable_checkpoint_scheduling": false,
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""")

# ---- group: controlnet scribble tes
panel_6 = Panel("weird green cows")
toggle = BooleanToggle(True)  # disabled
toggle_2 = BooleanToggle(True)  # disabled
number_slider = Slider(22, range=0..50)  # disabled
models = GetControlnetModels(Send=toggle, APIAddress="http://127.0.0.1:7860")  # -> Models, Debug; disabled
modules = GetControlnetModules(Send=toggle_2, APIAddress="http://127.0.0.1:7860")  # -> Models, Debug; disabled
item = ListItem(List=modules.Models, Index=number_slider, Wrap=True)  # disabled
panel_7 = Panel("delicious apple")  # disabled
panel_8 = Panel(item)  # disabled
panel_9 = Panel(models.Models)  # disabled
path_2 = FilePath("C:\Users\taole\source\repos\Printborg\PrintborgGH\user_sketch\scribbleTest_01.png")  # disabled
panel_10 = Panel("20")  # disabled
panel_11 = Panel("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")  # disabled
panel_12 = Panel("scribble_hed")  # disabled
panel_13 = Panel("control_v11p_sd15_scribble [d4ba51ff]")  # disabled
ao_scripts = CreateAlwaysOnScripts(Model=panel_13, Module=panel_12, InputImage=panel_11)  # disabled
panel_14 = Panel("tests")  # disabled
panel_15 = Panel("128")  # disabled
path_3 = FilePath("D:\Repos\Printborg\PrintborgGH\user_sketch\output\")  # disabled
toggle_3 = BooleanToggle(True)  # disabled
a1111payload = CreateAuto1111Payload(
    Prompt=panel_7,
    NegativePrompt="bad, worse, low quality, strange, ugly",
    SamplerName="Euler",
    Steps=panel_10,
    Width=panel_15,
    Height=panel_15,
    AlwaysOnScripts=ao_scripts)  # disabled
a1111t2i = A1111TextToImageGeneration(Generate=toggle_3, APIAddress="http://127.0.0.1:7860", Payload=a1111payload, FileDirectory=path_3, FileName=panel_14)  # -> Images, Strings, Debug; disabled
img = Image(a1111t2i.Images)  # disabled
txt = Text(a1111t2i.Strings)  # disabled
panel_16 = Panel(a1111t2i.Debug)  # disabled
img_2 = Image(txt)  # disabled
txt_2 = Text(img)  # disabled
image = DisplayImage(Plane=PlaneXY(0, 0, 0), Scale=1)  # disabled
panel_17 = Panel(txt_2)  # disabled
gallery = ImageGallery(CycleDelay=30, Randomize=False, UseLocalImages=True, UseRemoteImages=True)

# ----
deforum = SendDeforumJob(Generate=Button(), APIAddress="http://127.0.0.1:7860", Payload=panel_5)  # -> SuccessStatus, BatchID
panel_19 = Panel(deforum.BatchID)
panel_20 = Panel(deforum.SuccessStatus)
check_deforum = CheckDeforumProgress(On=Button(), APIAddress="http://127.0.0.1:7860", BatchID=panel_19, QueryInterval="2")  # -> Status, Phase, Progress, UpdatesCount, Debug
panel_21 = Panel(check_deforum.Status)
panel_22 = Panel(check_deforum.UpdatesCount)
panel_23 = Panel(check_deforum.Phase)
panel_24 = Panel(check_deforum.Progress)
get_djobs = GetAllDeforumJobs(APIAddress="http://127.0.0.1:7860", Submit=Button())  # -> Jobs, Debug
djob = DeforumJob(get_djobs.Jobs)
decon_djob = DeconstructDeforumJob(DeforumJob=djob)  # -> ID, Status, Phase, Error, Progress, StartedAt, LastUpdated, ExecutionTime, Updates, Outdir

panel_25 = Panel(decon_djob.ID)
panel_26 = Panel(decon_djob.Status)
panel_27 = Panel(decon_djob.Phase)
panel_28 = Panel(decon_djob.Progress)
panel_29 = Panel(decon_djob.ExecutionTime)
panel_30 = Panel(decon_djob.Updates)
panel_31 = Panel(decon_djob.Outdir)

item_2 = ListItem(List=panel_31, Index=0, Wrap=True)
loaddirimg = LoadImagesFromDir(Directory=item_2, Scale=1)
path_4 = FilePath("D:\Repos\Printborg\PrintborgGH\user_sketch\Deforum_20230822170836\20230822170836_000000000.png")
item_3 = ListItem(List=loaddirimg, Index=0, Wrap=True)

# ----
# connect this instead!
img_3 = Image(item_3)

# ---- group: test images
path_5 = FilePath("D:\Repos\Printborg\PrintborgGH\user_sketch\Deforum_20230822170836\20230822170836_000000097.png")
path_6 = FilePath("D:\Repos\Printborg\PrintborgGH\user_sketch\bmpTest.png")
path_7 = FilePath("D:\Repos\Printborg\PrintborgGH\user_sketch\gradientTest_512_b.png")
path_8 = FilePath("D:\Repos\Printborg\PrintborgGH\user_sketch\gradientTest.png")

# ----
path_9 = FilePath("C:\Users\Tao\Sync\03_ACADEMIC\05_AI_AM\tests\20231218164959_000000027.png")
# Bitmap Sources and Image Lofting: Bitmap Sources are the most primitive way to define an image pattern to modify the voxel field.  In essence, the Bitmap Source simply defines the image path and the channel to sample (i.e. red, green, blue, brightness, saturation, etc). The Add or Multiply Sources component will iterate through the voxel field and sample the image for the specified channel and add/multiply it with the base value.  How a bitmap source is oriented/mapped in three dimensions can be modified using one of the other image-based components (i.e. Image Loft or Image Blend).
# The Image Loft component creates an interpolation between images stacked along the Z axis. You can add as many Bitmap Sources to the image input and it will interpolate between them using the Z-axis normalized values (i.e. 0-1).  Note, the list order in which you add the bitmaps and Z-axis locations is important.
number_slider_2 = Slider(0.2, range=0..1)
loadimg = LoadImage(FilePath=path_9, Scale=1)

# ----
# 02_Monolith_Circle_01.jpg
number_slider_3 = Slider(1, range=-1..1)
file_path = FilePath("C:\Users\Tao\Downloads\6e805b801b463f638bda833afa337bc598ec50fb.jpeg")
img_source = ConstructImageSource(BitmapPath=file_path, Channel=6, Strength=number_slider_3)

# ----
# 02_Monolith_Cross_02.jpg
number_slider_4 = Slider(1, range=-1..1)
file_path_2 = FilePath("C:\Users\Tao\Sync\03_ACADEMIC\05_AI_AM\tests\20231218164959_000000027.png")
img_source_2 = ConstructImageSource(BitmapPath=file_path_2, Channel=6, Strength=number_slider_4)

# ----
# right-click to
# set image path
# 02_Monolith_Cross_01.jpg
number_slider_5 = Slider(1, range=-1..1)
file_path_3 = FilePath("C:\Users\Tao\Sync\03_ACADEMIC\05_AI_AM\tests\20231218125452_000000003.png")
img_source_3 = ConstructImageSource(BitmapPath=file_path_3, Channel=6, Strength=number_slider_5)

# ----
# 02_Monolith_Ring_01.jpg
number_slider_6 = Slider(1, range=-1..1)
file_path_4 = FilePath("C:\Users\Tao\Sync\03_ACADEMIC\05_AI_AM\tests\20231218142047_000000007.png")
img_source_4 = ConstructImageSource(BitmapPath=file_path_4, Channel=6, Strength=number_slider_6)

center_box = CenterBox(Base=PlaneXY(0, 0, 0), X=1, Y=1, Z=number_slider_2)
image_2 = DisplayImage(Image=loadimg, Plane=PlaneXY(0, 0, 0), Scale=1)
mesh = Mesh(image_2)

# ----
# Create a Voxel Field: To start, you must first create a voxel field which defines the boundary, the voxel resolution, and the channel configuration.  Note, that in this example we have overridden the default channel configuration such that the base voxel field has four channels (Shape, Red, Green, and Blue).
panel_32 = Panel("3")
construct_base_voxels = ConstructBaseVoxels(Box=center_box, Resolution=48, BaseChannelTypes=panel_32, Fill=0)

# ---- group: generate field from colored mesh
frepmesh = FRepFromMesh(Mesh=mesh, IsoValue="0")
data_fieldtop = Data(frepmesh)

# ----
bitmap_loft = BitmapLoft(
    BitmapSources=[img_source_3, img_source_4, img_source_2],
    Locations=[Slider(0, range=0..1), Slider(0.5, range=0..1), Slider(1, range=0..1)])

# ----
# Image Blending: The Image Blend component extrudes and combines three images along each of the XYZ axes. In the example below, a simple radial gradient is blended along each of the orthographic directions which then specifies one of the Red, Green, or Blue channels of the voxel field.
bitmap_blend = BitmapBlend(BitmapSource=img_source, BitmapSource_2=img_source)
bitmap_blend_2 = BitmapBlend(BitmapSource_2=img_source, BitmapSource_3=img_source)
bitmap_blend_3 = BitmapBlend(BitmapSource=img_source, BitmapSource_3=img_source)

# ---- group: iso contour value
number_slider_7 = Slider(-0.085, range=-20..20)

# ----
# Add/Multiply Sources: Here we simply add the sources together and then extract the iso-surface.  Note, we can use a single numeric value for the isosurface threshold, or a domain between two values (as in the example below).
add_sources = AddSources(
    Voxels=construct_base_voxels,
    Shape=flatten(bitmap_loft),
    Red=flatten(bitmap_blend),
    Green=flatten(bitmap_blend_2),
    Blue=flatten(bitmap_blend_3),
    variables="Shape,Red,Green,Blue")
construct_domain = ConstructDomain(DomainStart=Slider(0.733, range=0..1), DomainEnd=Slider(0.805, range=0..1))
get_channel_names = GetChannelNames(Voxels=add_sources, variables="Shape,Red,Green,Blue")  # -> Shape, Red, Green, Blue
get_iso_mesh = GetIsoMesh(Voxels=add_sources, Channel=get_channel_names.Shape, IsoValue=construct_domain, CapEdgeFaces=True)

construct_geometric_source = ConstructGeometricSource(Strength=1, Decay=20, Type=2)
construct_bitmap_stack_source = ConstructBitmapStackSource()

# ---- group: extract frep object as layers
mesh_layermeshes = Mesh(mesh)
numisocontourvalue = Number(number_slider_7)
data_layerfields = Data(data_fieldtop)
isoconmulti = IsoContour(Mesh=graft(mesh_layermeshes), Field=graft(data_layerfields), Tolerance=1, IsoValue=numisocontourvalue)
crv_toolpaths = Curve(isoconmulti)

# ----
voxcreate = CreateVoxelGrid()
voxgeo = VoxelateGeometry(Distance=0)
panel_33 = Panel(crv_toolpaths)
mesh_2 = Mesh(get_iso_mesh)

# ----
# Coloring the Mesh by RGB Channels: There are two Mesh Coloring components, one of which allows you to use a voxel channel to specify the Red, Green, and Blue color values of a mesh.  In this example, we have use an Image Blend component to interpolate a radial gradient along the XYZ axis.
color_mesh_by_rgb = ColorMeshByRGB(
    Voxels=add_sources,
    Mesh=get_iso_mesh,
    Red=get_channel_names.Red,
    Green=get_channel_names.Green,
    Blue=get_channel_names.Blue)  # disabled
