# Grasshopper definition stableDif_test00_230614.gh (Grasshopper 1.0.7)
# plug-ins: AI_Print

path = FilePath("C:\Users\taole\source\repos\AI_Print\AI_Print\user_sketch\output\")
panel = Panel("sk-KbD1s3SPXGcnNDDKkzdhSLKwPkP0GWQUtkbIsECaBj3Umeht")
panel_2 = Panel("100")
mplane = MeshPlane(Boundary={Plane=PlaneXY(0, 0, 0), Size=Domain2(u=-10..10, v=-10..10)}, WidthCount=10, HeightCount=10)  # -> Mesh, Area
crv = Curve(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)
cyclomatron_x = SampleAsyncComponent(Generate=Button(), APIKey=panel, Prompt=Slider(34, range=0..100), FileDirectory=path, FileName="test1")  # -> Output, Debug
t2i = TextToImagePrompt(Generate=Button(), APIKey=panel, Prompt="weird green cows", FileDirectory=path, FileName="test1")  # -> RawPOSTResponse, Link; disabled
panel_3 = Panel(t2i.RawPOSTResponse)
panel_4 = Panel(t2i.Link)
amfield = AreaMeshField(BaseMesh=mplane.Mesh, DrawingInput=crv, IsoValue=Slider(0, range=-1..1), Tolerance=1)  # -> MeshField, Debug
fblendmult = BlendFieldsMultiThreaded()  # -> Debug, BlendFields
panel_5 = Panel(cyclomatron_x.Debug)
col = Colour([ColourSwatch(SwatchColor=RGB(166, 171, 19)), ColourSwatch(SwatchColor=RGB(8, 0, 255))])
fdisp = FieldDisplay(Mesh=mplane.Mesh, Field=amfield.MeshField, Colors=col)
